# Grasshopper definition SV_EJ01.gh (Grasshopper 0.9.76)
# plug-ins: Python Interpreter

pt = Point(<point referenced from the Rhino model>)
python = PythonScript(PtoO=pt, Dist=Slider(2, range=0..10), intN=Slider(50, range=0..100), sSeed=Slider(5, range=0..10))  # -> out, a; inputs PtoO: Point3d, Dist: Int32, intN: Int32
# ---------- python: Python ----------
#importamos bibliotecas
import rhinoscriptsyntax as rs
import random as rd
import Rhino.Geometry as rg

#creamos una función que nos crea el módulo aleatorio a valores regulados
def aMod(valor):
    #print valor
    if valor <= 0.3:
        return -1
    elif valor > 0.3 and valor <= 0.6:
        return 0
    elif valor > 0.6:
        return 1
    else:
        print ("Entrada fuera de rango")#Mensaje de control, no puede salir

#configuramos random para un seed aportado por usuario.
rd.seed(int(sSeed))

#punto origen aportado por usuario y acumulador de resultados
origen = rg.Point3d(PtoO)
resultado=[]

for i in range(intN):
    #coordenadas de vector
    vx= aMod(rd.random())
    vy= aMod(rd.random())
    
    #vector de recta
    VtoF = rg.Vector3d(vx,vy,0)
    
    #trazo de la recta final
    trazo=rg.Line(origen, VtoF)
    resultado.append(trazo)
    
    
    #preparamos para el siguiente bucle
    punto = rg.Point3d(origen+VtoF)
    origen = rg.Point3d(punto)
    
#suma de todos los trazos lo dejamos para la salida
a = resultado
# ---------- end python ----------
panel = Panel(python.out)
crv = Curve(python.a)
