# Grasshopper definition SV_EJ02.gh (Grasshopper 0.9.76)
# plug-ins: Python Interpreter

pt = Point(<point referenced from the Rhino model>)
python = PythonScript(PtoO=pt, intN=Slider(10, range=0..10000), sSeed=Slider(7, range=0..10))  # -> out, a; inputs PtoO: Point3d, intN: Int32, sSeed: Int32
# ---------- python: Python ----------
"""Alumno: Sergi Viel
    usuario: evokraken
    version 03.00
"""
"""
CONTROL DE CAMBIOS
1-Borra y limpiar comentarios e instrucciones comentadas de versiones anteriores
2-Forzar Type Hint del componente de GH. Lin-19
3-Forzamos la variable PtoO Point3d en Type Hint del componente. Ya no tenemos
que tipificar en lineas 21, 34 y 35.

"""

import random as rd
import Rhino.Geometry as rg

#configuramos random para un seed aportado por usuario.
rd.seed(sSeed)

#punto origen aportado por usuario y acumulador de resultados
origen = (PtoO)
resultado=[]
VtoF = rg.Vector3d(1,1,0)
axisZ = rg.Vector3d(0,0,1)

for i in range(intN):
    #vector de recta
    #VtoF = rg.Vector3d(rd.randint(-1,1),rd.randint(-1,1),0)
    radian = 1*rd.random()*rd.choice(range(-1,1,2))
    VtoFF = rg.Vector3d.Rotate(VtoF,radian,axisZ)
    
    #trazo de la recta final
    trazo=rg.Line(origen,VtoFF)
    resultado.append(trazo)
    
    
    #preparamos para el siguiente bucle
    punto = (origen+VtoFF)
    origen = (punto)
    
#suma de todos los trazos lo dejamos para la salida
a = resultado
# ---------- end python ----------
crv = Curve(python.a)
panel = Panel(python.out)
