# Grasshopper definition SV_EJ_03.gh (Grasshopper 0.9.76)
# Copyright: Ángel Linares García 2014
# plug-ins: Python Interpreter

# EJERCICIO_003: En este ejercicio introduciremos la creación de árboles de datos dentro de nuestros componentes de Python, así como el uso del Type Hint "List" para iterar automáticamente en cada rama de nuestro arbol de datos.
# 
# También utilizaremos condicionales para establecer condiciones simples en nuestro modelo y comprobar condiciones impuestas.
# 
# Ejercicio propuesto: decorar los paneles por grupos.
srf = Surface(reparameterize(<surface referenced from the Rhino model>))
# CODE Divide Srf: import Rhino.Geometry as rg
# from Grasshopper import DataTree as Tree
# from Grasshopper.Kernel.Data import GH_Path as Path
# 
# ptList = []
# ptTree = Tree[object]()
# pl = []
# 
# for i in range(uDiv+1):
#     ptListTemp = []
#     for j in range(vDiv+1):
# 
#         tempPt = srf.Evaluate(i/uDiv,j/vDiv,2)[1]
#         ptTree.Add(tempPt,Path(i))
#         ptListTemp.append(tempPt)
#     ptList.append(ptListTemp)
# 
# for i in range(uDiv):
#     for j in range(vDiv):
# 
#         pt1 = ptList[i][j]
#         pt2 = ptList[i+1][j]
#         pt3 = ptList[i][j+1]
#         pt4 = ptList[i+1][j+1]
# 
#         pl.append(rg.Polyline([pt1,pt2,pt4,pt3,pt1]))
# 
# a = ptList
dividesrf = PythonScript(srf=srf, uDiv=Slider(25, range=1..25), vDiv=Slider(10, range=1..25))  # -> out, flatten(pl), triP; inputs srf: Surface, uDiv: Int32, vDiv: Int32
# ---------- dividesrf: Python ----------
import Rhino.Geometry as rg
import rhinoscriptsyntax as rs

ptList = []
ptListP = []
pl = []
triP = []

#Obtenemos puntos de la superficie en una lista de lista. Matriz
for i in range(uDiv+1):
    ptListTemp = []
    for j in range(vDiv+1):
        
        ptTemp = srf.Evaluate(i/uDiv,j/vDiv,2)[1]
        ptListTemp.append(ptTemp)
    ptList.append(ptListTemp)

#dibujar polilinea de 4 lados no coplanarios.
for i in range(uDiv):
    for j in range(vDiv):
        #puntos para cada subdivision que recorre la superficie
        pt1 = ptList[i][j]
        pt2 = ptList[i+1][j]
        pt3 = ptList[i+1][j+1]
        pt4 = ptList[i][j+1]
        
        #Añadimos polilineas a una lista para sacar el resultado
        pl.append(rg.Polyline([pt1,pt2,pt3,pt4,pt1]))
        
        #Generamos para cada triangulo una lista de tres puntos
        trianguloA = []
        trianguloB = []
        trianguloA.append(pt1)
        trianguloA.append(pt2)
        trianguloA.append(pt4)
        trianguloB.append(pt2)
        trianguloB.append(pt4)
        trianguloB.append(pt3)
        
        #creo las superficies que barren la superficie
        triP.append(rs.AddSrfPt(trianguloA))
        triP.append(rs.AddSrfPt(trianguloB))
# ---------- end dividesrf ----------
crv = Curve(dividesrf.pl)
srf_2 = Surface(dividesrf.triP)
# Planarize: import Rhino.Geometry as rg
# import rhinoscriptsyntax as rs
# 
# #Creamos un plano con tres puntos cualesquiera
# plane = rg.Plane(pts[0],pts[1],pts[2])
# 
# #Proyectamos el punto 3 sobre el plano calculado
# newPt3 = plane.ClosestPoint(pts[3])
# 
# #Calculamos el desplazamiento de cada punto
# dev = pts[3].DistanceTo(newPt3)
# 
# #Sustituimos el punto 3 por su nuevo valor
# pts[3] = newPt3
# lines = []
# 
# #Creamos una marca en cada panel fuera de tolerancia
# if dev>T:
# 
#     l0 = rg.Line(pts[0],pts[2])
#     l1 = rg.Line(pts[1],pts[3])
#     lines.extend([l0,l1])
# 
# #Creamos la polilinea de cada panel y calculamos su area
# pol = rg.PolylineCurve((pts[0],pts[1],pts[2],pts[3],pts[0]))
# 
# areaObj = rg.AreaMassProperties.Compute(pol)
# area = areaObj.Area
# 
# a = pts
# w = lines
panel = Panel(dividesrf.out)
