# Grasshopper definition Ej_004a_KOCH_curve.gh (Grasshopper 0.9.76)
# Copyright: Ángel Linares García 2014
# plug-ins: Python Interpreter

# EJERCICIO_005: En este ejercicio aprenderemos la utilidad de las funciones en el empaquetado de código y cómo utilizar estas para generar una nueva estructura para el control de flujo, la recursión. Este tipo de estructuras para el control de flujo son muy útiles para solucionar problemas que pueden resolverse aplicando una función una y otra vez sobre el resultado de ella misma.
# 
# En este caso, pare generar un resultado fácilmente reconocible de este proceso, vamos a generar una de las curvas fractales más sencillas, una curva de KOCH.
file = ReadFile(File="F:\003_CODE\Git\ghPython101\Día_003\01_EJ\Koch_curve.py", PerLineParse=False)
G = Slider(7, range=0..20)
pt = Point(<point referenced from the Rhino model>)
pt_2 = Point(<point referenced from the Rhino model>)
koch_crv = PythonScript(
    Code=file,
    PtA=pt_2,
    PtB=pt,
    Rat0=Slider(0.5, range=0..1),
    Rat1=Slider(0.5, range=0..1),
    Rat2=Slider(0.67, range=0..1),
    RatM=Slider(1.2, range=0..2),
    G=G)  # -> Out, Crv, Pts
