# Grasshopper definition Ej_004b_recursive_scaling.gh (Grasshopper 0.9.76)
# plug-ins: Python Interpreter

# EJERCICIO_004_a: Es este ejercicio abordaremos la creación de un algoritmo recursivo poco eficiente e intentaremos evidenciar porqué en algunos casos es más sencillo aplicar procesos iterativos en lugar de recursivos en la resolución de problemas.
# 
# Ojo con los valores que asignemos e los sliders, podemos hacer que Rhino se cierre con mucha facilidad.
# 
# Tarea: plantear la resolución del mismo problema desde un proceso iterativo.
file = ReadFile(File="F:\003_CODE\Git\ghPython101\Día_003\01_EJ\Recursive_scaling.py", PerLineParse=False)
crv = Curve(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)
target = Slider(1193, range=1..1500)
rec_scaling = PythonScript(Code=file, Crv=crv, Target=target, Step=Slider(0.107, range=0.001..1), Tolerance=Slider(5, range=5..15))  # -> Out, A
area = Area(Geometry=rec_scaling.A)  # -> Area, Centroid
