# Grasshopper definition Polyhedra.gh (Grasshopper 0.9.76)
# plug-ins: Python Interpreter

poly = Slider(4, range=0..10)
brep = Brep([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])
file = ReadFile(File="F:\003_CODE\Git\ghPython101\Día_004\01_EJ\Polyhedra_Subd_rec.py", PerLineParse=False)
item = ListItem(List=brep, Index=poly, Wrap=True)
python = PythonScript(Code=file, Brep=item, Dist=Slider(2.338, range=0..15), Gen=Slider(5, range=1..5))  # -> Out, A
panel = Panel(python.Out)
